# Grasshopper definition blocks_viz_01.gh (Grasshopper 1.0.7)

crv = Curve(<curve referenced from the Rhino model>)
# Import your base curve
crv_2 = Curve(<curve referenced from the Rhino model>)
crv_3 = Curve(<curve referenced from the Rhino model>)
# Create a dataset
number_slider = Slider(3.8, range=0..10)
crv_4 = Curve(<curve referenced from the Rhino model>)
Z = UnitZ(Factor=Slider(6, range=0..10))
# Use data to manipulate geometry
Z_2 = UnitZ(Factor=number_slider)
Z_3 = UnitZ(Factor=Slider(8.6, range=0..10))
Z_4 = UnitZ(Factor=Slider(2, range=0..10))
extr = Extrude(Base=crv, Direction=Z)
extr_2 = Extrude(Base=crv_2, Direction=Z_2)
extr_3 = Extrude(Base=crv_3, Direction=Z_3)
extr_4 = Extrude(Base=crv_4, Direction=Z_4)
cap = CapHoles(Brep=extr)
cap_2 = CapHoles(Brep=extr_2)
cap_3 = CapHoles(Brep=extr_3)
cap_4 = CapHoles(Brep=extr_4)
# Customize visualization
swatch = ColourSwatch(SwatchColor=RGB(0, 129, 209))
preview = CustomPreview(Geometry=cap, Material=ColourSwatch(SwatchColor=RGB(0, 209, 199)))
preview_2 = CustomPreview(Geometry=cap_2, Material=swatch)
preview_3 = CustomPreview(Geometry=cap_3, Material=ColourSwatch(SwatchColor=RGB(0, 209, 108)))
preview_4 = CustomPreview(Geometry=cap_4, Material=ColourSwatch(SwatchColor=RGB(206, 209, 0)))
