# Grasshopper definition blocks_viz_02.gh (Grasshopper 1.0.7)

# Create a dataset
number_slider = Slider(3.4, range=0..10)
# Import your base curve
crv = Curve([<curve referenced from the Rhino model> x4])
merge = Merge(Data1=number_slider, Data2=Slider(6.6, range=0..10), Data3=Slider(3.9, range=0..10), Data4=Slider(7.3, range=0..10))
# Use data to manipulate geometry
Z = UnitZ(Factor=merge)
extr = Extrude(Base=crv, Direction=Z)
cap = CapHoles(Brep=extr)
merge_2 = Merge(
    Data1=ColourSwatch(SwatchColor=RGB(0, 129, 209)),
    Data2=ColourSwatch(SwatchColor=RGB(0, 209, 199)),
    Data3=ColourSwatch(SwatchColor=RGB(0, 209, 108)),
    Data4=ColourSwatch(SwatchColor=RGB(206, 209, 0)))
# Customize visualization
preview = CustomPreview(Geometry=cap, Material=merge_2)
