# Grasshopper definition blocks_viz_03.gh (Grasshopper 1.0.7)

# Create a dataset
number_slider = Slider(3.4, range=0..10)
# Import your base curve
crv = Curve([<curve referenced from the Rhino model> x4])
merge = Merge(Data1=number_slider, Data2=Slider(6.6, range=0..10), Data3=Slider(3.9, range=0..10), Data4=Slider(7.3, range=0..10))
# Use data to manipulate geometry
Z = UnitZ(Factor=merge)
extr = Extrude(Base=crv, Direction=Z)
cap = CapHoles(Brep=extr)
# Customize visualization
panel = Panel("0")
gradient = Gradient(
    LowerLimit=panel,
    UpperLimit="10",
    Parameter=merge,
    stops=[0: RGB(234, 38, 0), 0.25: RGB(234, 126, 0), 0.5: RGB(254, 244, 84), 0.75: RGB(173, 203, 249), 1: RGB(75, 107, 169)])
preview = CustomPreview(Geometry=cap, Material=gradient)
