# Grasshopper definition blocks_viz_04.gh (Grasshopper 1.0.7)

# Create a dataset #1
number_slider = Slider(1.4, range=0..10)
# Create a dataset #2
number_slider_2 = Slider(4, range=0..10)
# Import your base curve
crv = Curve([<curve referenced from the Rhino model> x4])
merge = Merge(Data1=number_slider_2, Data2=Slider(9.3, range=0..10), Data3=Slider(0.9, range=0..10), Data4=Slider(2.4, range=0..10))
merge_2 = Merge(Data1=number_slider, Data2=Slider(2.7, range=0..10), Data3=Slider(3.9, range=0..10), Data4=Slider(7.3, range=0..10))
# Move base curves to top of extruded breps with dataset #1
Z = UnitZ(Factor=merge_2)
# Use data to manipulate geometry
Z_2 = UnitZ(Factor=merge_2)
move = Move(Geometry=crv, Motion=Z)  # -> Geometry, Transform
Z_3 = UnitZ(Factor=merge)
extr = Extrude(Base=crv, Direction=Z_2)
cap = CapHoles(Brep=extr)
extr_2 = Extrude(Base=move.Geometry, Direction=Z_3)
cap_2 = CapHoles(Brep=extr_2)
# Customize visualization
gradient = Gradient(
    LowerLimit="0",
    UpperLimit="10",
    Parameter=merge_2,
    stops=[0: RGB(234, 38, 0), 0.25: RGB(234, 126, 0), 0.5: RGB(254, 244, 84), 0.75: RGB(173, 203, 249), 1: RGB(75, 107, 169)])
gradient_2 = Gradient(
    LowerLimit="0",
    UpperLimit="10",
    Parameter=Z_3,
    stops=[0: RGB(0, 98, 0), 0.25: RGB(81, 175, 17), 0.5: RGB(159, 198, 146), 0.75: RGB(170, 235, 41), 1: RGB(221, 255, 53)])
preview = CustomPreview(Geometry=cap, Material=gradient)
preview_2 = CustomPreview(Geometry=cap_2, Material=gradient_2)
