# Grasshopper definition dear_data.gh (Grasshopper 1.0.7)
# plug-ins: Human

pipeline = GeometryPipeline(
    GroupByLayer=False,
    GroupByType=False,
    IncludeHidden=True,
    IncludeLocked=True,
    LayerFilter="bought_smth_symb",
    NameFilter="*",
    SublayerFiltering=True,
    TypeFilter=5)
panel = Panel("""4
4
2
1""")
# Work/play time data
panel_2 = Panel("""5
7
8
7""")
pt = Point(graft([<point referenced from the Rhino model> x10]))
crv = Curve(pipeline)
pt_2 = Point([<point referenced from the Rhino model> x4])
bbox = BoundingBox(Content=crv, Plane=PlaneXY(0, 0, 0), UnionBox=True)  # -> Box, Box_2
area = Area(Geometry=bbox.Box)  # -> Area, Centroid
circle = CircleCNR(Center=pt_2, Normal=Vector(0, 0, 1), Radius=panel_2)
circle_2 = CircleCNR(Center=pt_2, Normal=Vector(0, 0, 1), Radius=panel)
vec2pt = Vector2Pt(PointA=area.Centroid, PointB=pt, Unitize=False)  # -> Vector, Length
panel_3 = Panel("""30.5
20""")
# What did I buy data
panel_4 = Panel("""5
20
1""")
panel_5 = Panel("""20
50
5
2""")
move = Move(Geometry=crv, Motion=vec2pt.Vector)  # -> Geometry, Transform
crv_2 = Curve(circle)
crv_3 = Curve(circle_2)
dom = ConstructDomain(DomainStart=Slider(0.193, range=0..1), DomainEnd=Slider(0.377, range=0..1))
boundary = BoundarySurfaces(Edges=crv_3)
subcrv = SubCurve(BaseCurve=reparameterize(crv_2), Domain=dom)
preview = CustomPreview(Geometry=boundary, Material=ColourSwatch(SwatchColor=RGB(0, 0, 0)))
merge = Merge(Data1=panel_4, Data2="2.5", Data3=panel_5, Data4=panel_3)  # -> graft(Result)
crv_4 = Curve(subcrv)
panel_6 = Panel("1 To 2")
offset = OffsetCurve(Curve=crv_2, Distance="-0.5", Plane=PlaneXY(0, 0, 0), Corners=1)
dom_2 = ConstructDomain(DomainStart=Slider(0.5, range=0..1), DomainEnd=Slider(3, range=1..3))
remap = RemapNumbers(Value=merge, Source="1 To 50", Target=dom_2)  # -> Mapped, Clipped
dash = DashPattern(Curve=offset, Pattern=".5")  # -> Dashes, Gaps
scale = Scale(Geometry=move.Geometry, Center=pt, Factor=remap.Mapped)  # -> Geometry, Transform
previewlw = CustomPreviewLineweights(Geometry=crv_4, Shader=ColourSwatch(SwatchColor=RGB(0, 0, 0)), Thickness=Slider(7, range=0..10), Absolute=False)
previewlw_2 = CustomPreviewLineweights(Geometry=dash.Dashes, Shader=ColourSwatch(SwatchColor=RGB(0, 0, 0)), Thickness=Slider(2, range=0..10), Absolute=False)
previewlw_3 = CustomPreviewLineweights(Geometry=scale.Geometry, Shader=ColourSwatch(SwatchColor=RGB(0, 0, 0)), Absolute=False)
# N meetings data
panel_7 = Panel("""10
5
2
7""")
panel_8 = Panel("""45
60
60
60
30
30
45""")
# Meeting duration data
panel_9 = Panel("""30
30
45
15
20
30
60
60
120
60""")
panel_10 = Panel("""45
60
60
30
60""")
panel_11 = Panel("""60
30""")
divide = DivideCurve(Curve=crv_4, Count=panel_7, Kinks=False)  # -> Points, Tangents, Parameters
pi = Pi(Factor=Slider(0.5, range=0..1))
Z = UnitZ(Factor=1)
vrot = Rotate(Vector=divide.Tangents, Axis=Z, Angle=pi)
neg = Negative(Value=vrot)
entwine = Entwine(Branch00=panel_9, Branch01=panel_10, Branch02=panel_11, Branch03=panel_8, FlattenInputs=True)
amp = Amplitude(Vector=neg, Amplitude=Slider(0.623, range=0..1))
remap_2 = RemapNumbers(Value=entwine, Source="15 To 120", Target="1 to 10")  # -> Mapped, Clipped
move_2 = Move(Geometry=divide.Points, Motion=amp)  # -> Geometry, Transform
line = LineSDL(Start=move_2.Geometry, Direction=neg, Length=remap_2.Mapped)
previewlw_4 = CustomPreviewLineweights(Geometry=line, Shader=ColourSwatch(SwatchColor=RGB(0, 0, 0)), Thickness=Slider(2, range=0..10), Absolute=False)
