# Grasshopper definition inclass.gh (Grasshopper 1.0.7)

work_time = Panel("""8
3
12
8""")
play_time = Panel("""3
2
5
4""")
# WORK/PLAY TIME VIZ
pt = Point([<point referenced from the Rhino model> x4])
circle = CircleCNR(Center=pt, Normal=Vector(0, 0, 1), Radius=work_time)
circle_2 = CircleCNR(Center=pt, Normal=Vector(0, 0, 1), Radius=play_time)
crv = Curve(circle)
crv_2 = Curve(circle_2)
swatch = ColourSwatch(SwatchColor=RGB(0, 0, 0))
dash = DashPattern(Curve=crv, Pattern=[Slider(0.8, range=0.5..2), Slider(1, range=0.5..2)])  # -> Dashes, Gaps
boundary = BoundarySurfaces(Edges=crv_2)
preview = CustomPreview(Geometry=dash.Dashes, Material=ColourSwatch(SwatchColor=RGB(0, 0, 0)))
panel = Panel(swatch)
preview_2 = CustomPreview(Geometry=boundary, Material=swatch)
crv_3 = Curve(crv)
panel_2 = Panel(crv_3)
offset = OffsetCurve(Curve=crv_3, Distance=Slider(0.498, range=0..1), Plane=PlaneXY(0, 0, 0), Corners=1)  # -> flatten(Curve)
panel_3 = Panel(offset)
dom = ConstructDomain(DomainStart=Slider(0.096, range=0..1), DomainEnd=Slider(0.372, range=0..1))
subcrv = SubCurve(BaseCurve=reparameterize(offset), Domain=dom)
n_of_meetings = Panel("""10
5
2
7""")
crv_4 = Curve(subcrv)
panel_4 = Panel("""45
60
60
60
30
30
45""")
panel_5 = Panel("""60
30""")
panel_6 = Panel("""30
30
45
15
20
30
60
60
120
60""")
panel_7 = Panel("""45
60
60
30
60""")
preview_3 = CustomPreview(Geometry=crv_4, Material=ColourSwatch(SwatchColor=RGB(0, 0, 0)))
number_slider = Slider(5, range=1..10)
divide = DivideCurve(Curve=crv_4, Count=n_of_meetings, Kinks=False)  # -> Points, Tangents, Parameters
vdis = VectorDisplay(Anchor=divide.Points, Vector=divide.Tangents)
Z = UnitZ(Factor=1)
pi = Pi(Factor=Slider(0.5, range=0..1))
vrot = Rotate(Vector=divide.Tangents, Axis=Z, Angle=pi)
entwine = Entwine(Branch00=panel_6, Branch01=panel_7, Branch02=panel_5, Branch03=panel_4, FlattenInputs=True)
neg = Negative(Value=vrot)
vdis_2 = VectorDisplay(Anchor=divide.Points, Vector=neg)
dom_2 = ConstructDomain(DomainStart="30", DomainEnd="120")
dom_3 = ConstructDomain(DomainStart="2", DomainEnd="15")
remap = RemapNumbers(Value=entwine, Source=dom_2, Target=dom_3)  # -> Mapped, Clipped
line = LineSDL(Start=divide.Points, Direction=neg, Length=remap.Mapped)
crv_5 = Curve(line)
preview_4 = CustomPreview(Geometry=crv_5, Material=ColourSwatch(SwatchColor=RGB(0, 0, 0)))
