# Grasshopper definition dear_data.gh (Grasshopper 1.0.7)
# plug-ins: Human

panel = Panel("""4
4
2
1""")
# Work/play time data
panel_2 = Panel("""5
7
8
7""")
pt = Point([<point referenced from the Rhino model> x4])
circle = CircleCNR(Center=pt, Normal=Vector(0, 0, 1), Radius=panel_2)
circle_2 = CircleCNR(Center=pt, Normal=Vector(0, 0, 1), Radius=panel)
crv = Curve(circle_2)
dom = ConstructDomain(DomainStart=Slider(0.193, range=0..1), DomainEnd=Slider(0.377, range=0..1))
crv_2 = Curve(circle)
boundary = BoundarySurfaces(Edges=crv)
offset = OffsetCurve(Curve=crv_2, Distance="-0.5", Plane=PlaneXY(0, 0, 0), Corners=1)
subcrv = SubCurve(BaseCurve=reparameterize(crv_2), Domain=dom)
preview = CustomPreview(Geometry=boundary, Material=ColourSwatch(SwatchColor=RGB(0, 0, 0)))
crv_3 = Curve(subcrv)
dash = DashPattern(Curve=offset, Pattern=".5")  # -> Dashes, Gaps
previewlw = CustomPreviewLineweights(Geometry=crv_3, Shader=ColourSwatch(SwatchColor=RGB(0, 0, 0)), Thickness=Slider(7, range=0..10), Absolute=False)
previewlw_2 = CustomPreviewLineweights(Geometry=dash.Dashes, Shader=ColourSwatch(SwatchColor=RGB(0, 0, 0)), Thickness=Slider(2, range=0..10), Absolute=False)
# N meetings data
panel_3 = Panel("""10
5
2
7""")
panel_4 = Panel("""45
60
60
60
30
30
45""")
# Meeting duration data
panel_5 = Panel("""30
30
45
15
20
30
60
60
120
60""")
panel_6 = Panel("""45
60
60
30
60""")
panel_7 = Panel("""60
30""")
divide = DivideCurve(Curve=crv_3, Count=panel_3, Kinks=False)  # -> Points, Tangents, Parameters
Z = UnitZ(Factor=1)
pi = Pi(Factor=Slider(0.5, range=0..1))
vrot = Rotate(Vector=divide.Tangents, Axis=Z, Angle=pi)
entwine = Entwine(Branch00=panel_5, Branch01=panel_6, Branch02=panel_7, Branch03=panel_4, FlattenInputs=True)
neg = Negative(Value=vrot)
remap = RemapNumbers(Value=entwine, Source="15 To 120", Target="1 to 10")  # -> Mapped, Clipped
amp = Amplitude(Vector=neg, Amplitude=Slider(0.623, range=0..1))
move = Move(Geometry=divide.Points, Motion=amp)  # -> Geometry, Transform
line = LineSDL(Start=move.Geometry, Direction=neg, Length=remap.Mapped)
previewlw_3 = CustomPreviewLineweights(Geometry=line, Shader=ColourSwatch(SwatchColor=RGB(0, 0, 0)), Thickness=Slider(2, range=0..10), Absolute=False)
