# Grasshopper definition dear_data_globe.gh (Grasshopper 1.0.7)
# plug-ins: Human

income_inequality = Panel("""35
42
31
63""")
happiness = Panel("""4.74
5.87
6.07
4.88""")
# Country data
civic_engagement = Panel("""80
71
35
76""")
dom = ConstructDomain(DomainStart=Slider(10, range=0..100), DomainEnd=Slider(84, range=0..100))
remap = RemapNumbers(Value=civic_engagement, Source=dom, Target="1 To 2")  # -> Mapped, Clipped
pt = Point([<point referenced from the Rhino model> x4])
dom_2 = ConstructDomain(DomainStart=Slider(5, range=0..20), DomainEnd=Slider(20, range=0..20))
dom_3 = ConstructDomain(DomainStart=Slider(26, range=0..100), DomainEnd=Slider(58, range=0..100))
remap_2 = RemapNumbers(Value=income_inequality, Source=dom_3, Target=dom_2)  # -> Mapped, Clipped
circle = CircleCNR(Center=pt, Normal=Vector(0, 0, 1), Radius=happiness)
crv = Curve(circle)
boundary = BoundarySurfaces(Edges=crv)
preview = CustomPreview(Geometry=boundary, Material=ColourSwatch(SwatchColor=RGB(0, 0, 0)))
crv_2 = Curve(boundary)
Z = UnitZ(Factor=remap_2.Mapped)
area = Area(Geometry=crv_2)  # -> Area, Centroid
move = Move(Geometry=crv_2, Motion=Z)  # -> Geometry, Transform
scale = Scale(Geometry=crv_2, Center=area.Centroid, Factor=remap.Mapped)  # -> Geometry, Transform
dom_4 = ConstructDomain(DomainStart=Slider(0.203, range=0..1), DomainEnd=Slider(0.383, range=0..1))
crv_3 = Curve(scale.Geometry)
area_2 = Area(Geometry=move.Geometry)  # -> Area, Centroid
offset = OffsetCurve(Curve=crv_3, Distance="-0.5", Plane=PlaneXY(0, 0, 0), Corners=1)
subcrv = SubCurve(BaseCurve=reparameterize(crv_3), Domain=dom_4)
offset_2 = OffsetCurve(Curve=crv_3, Distance="2", Plane=PlaneXY(0, 0, 0), Corners=1)
scale_2 = Scale(Geometry=move.Geometry, Center=area_2.Centroid, Factor=Slider(0.25, range=0..1))  # -> Geometry, Transform
crv_4 = Curve(subcrv)
countries = Panel("""Tunisia
Philippines
Hungary
South Africa""")
curvepoint = PointOnCurve(offset_2, parameter=0.752)
entwine = Entwine(Branch00=crv_2, Branch01=scale_2.Geometry, FlattenInputs=True)
dash = DashPattern(Curve=offset, Pattern=".5")  # -> Dashes, Gaps
flip = FlipMatrix(Data=entwine)
loft = Loft(Curves=flip, Options={Adjust=False, Closed=False, LoftEnds=0, LoftSimp=0, LoftType=0, Rebuild=10, Refit=0.01})
previewlw = CustomPreviewLineweights(Geometry=crv_4, Shader=ColourSwatch(SwatchColor=RGB(0, 0, 0)), Thickness=Slider(7, range=0..10), Absolute=False)
previewlw_2 = CustomPreviewLineweights(Geometry=dash.Dashes, Shader=ColourSwatch(SwatchColor=RGB(0, 0, 0)), Thickness=Slider(2, range=0..10), Absolute=False)
tag = TextTag3D(Location=curvepoint, Text=graft(countries), Size=1, Colour=ColourSwatch(SwatchColor=RGB(0, 0, 0)), Justification=5)
brep = Brep(loft)
cap = CapHoles(Brep=brep)
preview_2 = CustomPreview(Geometry=cap, Material=ColourSwatch(SwatchColor=RGB(161, 120, 120)))
# 10 yr Voter turnout
panel = Panel("""91
86
92
67
41""")
panel_2 = Panel("""89
76
77
73
66""")
panel_3 = Panel("""63
75
77
82
74""")
panel_4 = Panel("""74
70
61
60
69""")
entwine_2 = Entwine(
    Branch00=reverse(panel),
    Branch01=reverse(panel_3),
    Branch02=reverse(panel_4),
    Branch03=reverse(panel_2),
    FlattenInputs=True)
bnd = Bounds(Numbers=flatten(entwine_2))
remap_3 = RemapNumbers(Value=entwine_2, Source=bnd, Target="1 to 7")  # -> Mapped, Clipped
lng = ListLength(List=remap_3.Mapped)  # -> flatten(Length)
divide = DivideCurve(Curve=crv_4, Count=lng, Kinks=False)  # -> Points, Tangents, Parameters
Z_2 = UnitZ(Factor=1)
pi = Pi(Factor=Slider(0.5, range=0..1))
vrot = Rotate(Vector=divide.Tangents, Axis=Z_2, Angle=pi)
neg = Negative(Value=vrot)
amp = Amplitude(Vector=neg, Amplitude=Slider(0.535, range=0..1))
amp_2 = Amplitude(Vector=neg, Amplitude=Slider(1, range=0..1))
move_2 = Move(Geometry=divide.Points, Motion=amp)  # -> Geometry, Transform
line = LineSDL(Start=move_2.Geometry, Direction=neg, Length=remap_3.Mapped)
move_3 = Move(Geometry=line, Motion=amp_2)  # -> Geometry, Transform
previewlw_3 = CustomPreviewLineweights(Geometry=line, Shader=ColourSwatch(SwatchColor=RGB(0, 0, 0)), Thickness=Slider(2, range=0..10), Absolute=False)
end = EndPoints(Curve=move_3.Geometry)  # -> Start, End
pt_2 = Point(end.End)
nurbs = NurbsCurve(Vertices=pt_2, Degree=3, Periodic=False)  # -> Curve, Length, Domain
dots = DotDisplay(Point=pt_2, Colour=RGB(0, 0, 0), Size=Slider(0.25, range=0..1))
previewlw_4 = CustomPreviewLineweights(Geometry=nurbs.Curve, Shader=ColourSwatch(SwatchColor=RGB(0, 0, 0)), Thickness=Slider(2, range=0..10), Absolute=False)
