# Grasshopper definition dear_data_globe.gh (Grasshopper 1.0.7)
# plug-ins: Human

civic_engagement = Panel("""80
71
35
76""")
# Happiness, Civic Engagm. and Ineq. Viz
number_slider = Slider(10, range=0..100)
happiness = Panel("""4.74
5.87
6.07
4.88""")
income_inequality = Panel("""35
42
31
63""")
pt = Point([<point referenced from the Rhino model> x4])
dom = ConstructDomain(DomainStart=number_slider, DomainEnd=Slider(84, range=0..100))
circle = CircleCNR(Center=pt, Normal=Vector(0, 0, 1), Radius=happiness)
remap = RemapNumbers(Value=civic_engagement, Source=dom, Target="1 To 2")  # -> Mapped, Clipped
crv = Curve(circle)
boundary = BoundarySurfaces(Edges=crv)
dom_2 = ConstructDomain(DomainStart=Slider(26, range=0..100), DomainEnd=Slider(58, range=0..100))
dom_3 = ConstructDomain(DomainStart=Slider(5, range=0..20), DomainEnd=Slider(20, range=0..20))
preview = CustomPreview(Geometry=boundary, Material=ColourSwatch(SwatchColor=RGB(0, 0, 0)))
remap_2 = RemapNumbers(Value=income_inequality, Source=dom_2, Target=dom_3)  # -> Mapped, Clipped
Z = UnitZ(Factor=remap_2.Mapped)
neg = Negative(Value=Slider(0.191, range=0..1))
dedomain = DeconstructDomain(Domain=dom_3)  # -> Start, End
Z_2 = UnitZ(Factor=neg)
gradient = Gradient(
    LowerLimit=dedomain.Start,
    UpperLimit=dedomain.End,
    Parameter=remap_2.Mapped,
    stops=[0.15: RGB(138, 192, 255), 0.85: RGB(220, 0, 40)])

# ---- group: Happiness circle
crv_2 = Curve(boundary)

# ----
area = Area(Geometry=crv_2)  # -> Area, Centroid
scale = Scale(Geometry=crv_2, Center=area.Centroid, Factor=remap.Mapped)  # -> Geometry, Transform
move = Move(Geometry=crv_2, Motion=Z)  # -> Geometry, Transform
area_2 = Area(Geometry=move.Geometry)  # -> Area, Centroid
scale_2 = Scale(Geometry=move.Geometry, Center=area_2.Centroid, Factor=Slider(0.25, range=0..1))  # -> Geometry, Transform
crv_3 = Curve(scale_2.Geometry)
entwine = Entwine(Branch00=crv_2, Branch01=scale_2.Geometry, FlattenInputs=True)
darc = DeconstructArc(Arc=crv_3)  # -> BasePlane, Radius, Angle
flip = FlipMatrix(Data=entwine)
loft = Loft(Curves=flip, Options={Adjust=False, Closed=False, LoftEnds=0, LoftSimp=0, LoftType=0, Rebuild=10, Refit=0.01})
sph = Sphere(Base=darc.BasePlane, Radius=darc.Radius)
brep = Brep(loft)
move_2 = Move(Geometry=sph, Motion=Z_2)  # -> Geometry, Transform
cap = CapHoles(Brep=brep)
sunion = SolidUnion(Breps=flatten([move_2.Geometry, cap]))
preview_2 = CustomPreview(Geometry=sunion, Material=gradient)

# ---- group: Civic Engagm circle
crv_4 = Curve(scale.Geometry)

# ----
offset = OffsetCurve(Curve=crv_4, Distance="-0.5", Plane=PlaneXY(0, 0, 0), Corners=1)
dash = DashPattern(Curve=offset, Pattern=".5")  # -> Dashes, Gaps
previewlw = CustomPreviewLineweights(Geometry=dash.Dashes, Shader=ColourSwatch(SwatchColor=RGB(0, 0, 0)), Thickness=Slider(2, range=0..10), Absolute=False)

# ---- group: Civic Engagm circle
crv_5 = Curve(scale.Geometry)

# ----
offset_2 = OffsetCurve(Curve=crv_5, Distance="2", Plane=PlaneXY(0, 0, 0), Corners=1)
# Country Names
countries = Panel("""Tunisia
Philippines
Hungary
South Africa""")
curvepoint = PointOnCurve(offset_2, parameter=0.752)
fonts = FontTable()
panel = Panel(fonts)
tdist = TextDistance(TextA="Times New roman", TextB=fonts, Case=True)
smaller = SmallerThan(FirstNumber=tdist, SecondNumber="1")  # -> SmallerThan, OrEqualTo
dispatch = Dispatch(List=fonts, DispatchPattern=smaller.OrEqualTo)  # -> ListA, ListB
panel_2 = Panel(dispatch.ListA)
justified_text = JustifiedText3d(
    Location=curvepoint,
    Text=graft(countries),
    Size=1,
    Color=ColourSwatch(SwatchColor=RGB(0, 0, 0)),
    HorizontalAlignment=1,
    VerticalAlginment=1,
    Font=dispatch.ListA,
    UseMeshes=False,
    Bake=False)

# ---- group: Civic Engagm circle
crv_6 = Curve(scale.Geometry)

# ----
# 10 yr Voter turnout
number_slider_2 = Slider(0.253, range=0..1)
tunisia = Panel("""91
86
92
67
41""")
south_africa = Panel("""89
76
77
73
66""")
philippines = Panel("""63
75
77
82
74""")
hungary = Panel("""74
70
61
60
69""")
dom_4 = ConstructDomain(DomainStart=number_slider_2, DomainEnd=Slider(0.375, range=0..1))
subcrv = SubCurve(BaseCurve=reparameterize(crv_6), Domain=dom_4)
entwine_2 = Entwine(
    Branch00=reverse(tunisia),
    Branch01=reverse(philippines),
    Branch02=reverse(hungary),
    Branch03=reverse(south_africa),
    FlattenInputs=True)
crv_7 = Curve(subcrv)
previewlw_2 = CustomPreviewLineweights(Geometry=crv_7, Shader=ColourSwatch(SwatchColor=RGB(0, 0, 0)), Thickness=Slider(7, range=0..10), Absolute=False)
dom_5 = ConstructDomain(DomainStart=Slider(30, range=0..100), DomainEnd=Slider(100, range=0..100))
remap_3 = RemapNumbers(Value=entwine_2, Source=dom_5, Target="1 to 7")  # -> Mapped, Clipped
lng = ListLength(List=remap_3.Mapped)  # -> flatten(Length)
divide = DivideCurve(Curve=crv_7, Count=expr("x-1", lng), Kinks=False)  # -> Points, Tangents, Parameters
Z_3 = UnitZ(Factor=1)
pi = Pi(Factor="0.5")
vrot = Rotate(Vector=divide.Tangents, Axis=Z_3, Angle=pi)
neg_2 = Negative(Value=vrot)
amp = Amplitude(Vector=neg_2, Amplitude=Slider(0.57, range=0..1))
amp_2 = Amplitude(Vector=neg_2, Amplitude=Slider(1, range=0..1))
move_3 = Move(Geometry=divide.Points, Motion=amp)  # -> Geometry, Transform
line = LineSDL(Start=move_3.Geometry, Direction=neg_2, Length=remap_3.Mapped)
end = EndPoints(Curve=line)  # -> Start, End
dash_2 = DashPattern(Curve=line, Pattern=[Slider(0.25, range=0..1), Slider(0.77, range=0..1)])  # -> Dashes, Gaps
move_4 = Move(Geometry=end.End, Motion=amp_2)  # -> Geometry, Transform
previewlw_3 = CustomPreviewLineweights(Geometry=dash_2.Dashes, Shader=ColourSwatch(SwatchColor=RGB(0, 0, 0)), Thickness=Slider(2, range=0..10), Absolute=False)
pt_2 = Point(move_4.Geometry)
nurbs = NurbsCurve(Vertices=pt_2, Degree=3, Periodic=False)  # -> Curve, Length, Domain
dots = DotDisplay(Point=pt_2, Colour=RGB(0, 0, 0), Size=Slider(0.32, range=0..1))
previewlw_4 = CustomPreviewLineweights(Geometry=nurbs.Curve, Shader=ColourSwatch(SwatchColor=RGB(0, 0, 0)), Thickness=Slider(2, range=0..10), Absolute=False)
